vi "Tx Continuous Async (CDB Cluster).gvi"   [LabVIEW NXG 5.0.0]
panel controls:
  "Gain": f64 = 10
  "Active Antenna": string = "TX1"
  "Enabled Channels": string = "0"
  "Device ID": "USRP niUSRPClass"
  "Array": T1[]
  "Initial Phase [Rad]": f64
  "Amplitude": f64
  "Duration per signal [s]": f64
  "timeout": f64 = 10
panel indicators:
  "Coerced IQ Rate": f64
  "Coerced Carrier Frequency": f64
  "Coerced Gain": f64
  "error out": error
  "Time Frequency": waveform<c128>
  "IQ graph": waveform<c128>
types:
  T1 = cluster{"Duration [s]": f64, "Number of chirps": i32, "On/off": bool, "Chirp Direction (Up/Down)": bool, "Carrier Frequency": f64, "IQ Rate": f64}
uses:
  NI::USRP::niUSRP Open Tx Session.gvi
  NI::USRP::niUSRP Configure Signal.gvi
  NI::Analysis::Generation::Ramp Pattern by Samples.gvi
  NI::USRP::niUSRP Write Tx Data (CDB).gvi
  NI::USRP::niUSRP Close Session.gvi
diagram:
  w1 = $"Enabled Channels"
  w2 = $"Device ID"
  s1 = 0  # shift register
  while {
    call "niUSRP Open Tx Session.gvi"(device names=w2, reset=TRUE) -> (session handle out=w3, error out=w4)
    Property Node(instance in=w3, "niUSRP"=w1, error in=w4) -> (error out=w5, instance out=w6)
    for {
      w7 = each element of $Array
      Property Node(instance in=w7) -> ("Duration [s]"=w14, "Number of chirps"=w15, "On/off"=w16, "Chirp Direction (Up/Down)"=w17, "Carrier Frequency"=w18, "IQ Rate"=w19)
      append w14 to w8
      append w15 to w9
      append w16 to w10
      append w17 to w11
      append w18 to w12
      append w19 to w13
    }
    Array Index(array=w12) -> (out0[s1]=w20)
    Array Index(array=w13) -> (out0[s1]=w21)
    call "niUSRP Configure Signal.gvi"(active antenna=$"Active Antenna", session handle=w6, error in=w5, IQ rate=w21, carrier frequency=w20, gain=$Gain, channel list=w1) -> (session handle out=w22, error out=w23, coerced IQ rate=w24, coerced carrier frequency=w25, coerced gain=w26)
    Reciprocal(x=w24) -> w27
    Array Index(array=w9) -> (out0[s1]=w28)
    Array Index(array=w8) -> (out0[s1]=w29)
    Divide(x=w29, y=w28) -> w30
    Multiply(w30, w24) -> w31
    Round To Nearest(number=w31) -> w32
    To Signed 64 Bit Integer(number=w32) -> w33
    Quotient And Remainder(x=w33, y=2) -> (x-y*floor(x/y)=w34)
    Add(w33, w34) -> w35
    Array Index(array=w11) -> (out0[s1]=w36)
    Divide(x=w24, y=2) -> w37
    Negate(x=w37) -> w38
    Select(s=w36, t=w37, f=w38) -> w39
    Add(w39, w25) -> w40
    Select(s=w36, t=w38, f=w37) -> w41
    Add(w25, w41) -> w42
    call "Ramp Pattern by Samples.gvi"(샘플=w35, 시작=w40, 끝=w42) -> (램프 패턴=w43)
    Real And Imaginary To Complex(x=w43, y=w43) -> w44
    s2 = c128[] []  # shift register
    for (N = w28) {
      Build Array(s2, w44) -> w45
      next s2 = w45
    }
    Build Waveform Node(Y=s2, dt=w27) -> (output waveform=w46)
    $"Time Frequency" <- w46
    New Data Value Reference(data value=w46, error in (no error)=w23) -> (data value reference=w47, error out=w48)
    in-place (after w47) {
      Read Poser(ro0=w47) -> (ri0=w49)
      Property Node(instance in=w49) -> ("Y"=w50)
      Complex To Real And Imaginary(x + iy=w50) -> w51
      Multiply(w51, f64 default) -> w52
      s3 = $"Initial Phase [Rad]"  # shift register
      for {
        w53 = each element of w52
        # Cumulative phase
        # dt = 1/Hz = 1/IQrate
        Multiply(w53, w27) -> w55
        Add(w55, s3) -> w56
        append w56 to w54
        next s3 = w56
      }
      Sine And Cosine(x=w54) -> (cos(x)=w57, sin(x)=w58)
      Real And Imaginary To Complex(x=w57, y=w58) -> w59
      Multiply(w59, $Amplitude) -> w60
      Property Node(instance in=w49, "Y"=w60) -> (instance out=w61)
      $"IQ graph" <- w61
      Write Poser(wi0=w61)
    }
    Array Index(array=w10) -> (out0[s1]=w62)
    Select(s=w62, t=1, f=0) -> w63
    Multiply(w59, w63) -> w64
    Multiply(w64, 0) -> w65
    Build Array(w64, w65) -> w66
    Divide(x=$"Duration per signal [s]", y=2) -> w67
    Divide(x=w67, y=w29) -> w68
    s4 = w66  # shift register
    for (N = w68) {
      Build Array(s4, w66) -> w69
      next s4 = w69
    }
    call "niUSRP Write Tx Data (CDB).gvi"(session handle=w22, error in=w48, data=s4, timeout=$timeout, channel list=w1) -> (session handle out=w70, error out=w71)
    $"Coerced IQ Rate" <- w24
    $"Coerced Carrier Frequency" <- w25
    $"Coerced Gain" <- w26
    Add(s1, 1) -> w72
    Array Size(array=w13) -> (size(s)=w73)
    Is Equal(x=w73, y=w72) -> w74
    next s1 = w72
    stop if w74
  }
  call "niUSRP Close Session.gvi"(session handle=w70, error in=w71) -> (error out=w75)
  $"error out" <- w75
